# Grasshopper definition 1.gh (Grasshopper 1.0.5)
# plug-ins: Barnacle

point = Point([Point(180, -90, 0), Point(269.4811383, -88.75369393, 0), Point(274.3489384, -26.37403309, 0), Point(176, -37.51779997, 0)])
list_item = ListItem(List=point, Index=0, Wrap=True)  # -> Item, Item1, Item2, Item3
barnacle = Barnacle(PointA=list_item.Item, PointB=list_item.Item1, PointC=list_item.Item2, PointD=list_item.Item3)
barnacle_2 = Barnacle()
